# Dynamo graph link excel to revit schedule_wall.dyn (Dynamo 1.2.2.373)

categories = Categories("Walls")
all_elements_of_category = ElementsOfCategory(categories)
string = StringInput("Delivery ID")
file_path = Filename(".\BIM_Dynamo.xlsx")
fromPath = FileObject(file_path)  # "File.FromPath"
string_2 = StringInput("shearwall")
readFromFile = Excel.ReadFromFile(file=fromPath, sheetName=string_2)
number = DoubleInput(1)
dropItems = List.DropItems(list=readFromFile, amount=number)
transpose = List.Transpose(dropItems)
code_block = CodeBlock { 1; }
# note: element ID built in parameter not to be changed
# note: Delivery ID
getItemAtIndex = List.GetItemAtIndex(list=transpose, index=code_block)
string_from_object = FromObject(getItemAtIndex)
setParameterByName = Element.SetParameterByName(element=all_elements_of_category, parameterName=string, value=string_from_object)
string_3 = StringInput("PO ID")
code_block_2 = CodeBlock { 2; }
# note: PO ID
getItemAtIndex_2 = List.GetItemAtIndex(list=transpose, index=code_block_2)
string_from_object_2 = FromObject(getItemAtIndex_2)
setParameterByName_2 = Element.SetParameterByName(element=all_elements_of_category, parameterName=string_3, value=string_from_object_2)
string_4 = StringInput("WBS code")
code_block_3 = CodeBlock { 3; }
# note: WBS code
# note: Length value read only.
getItemAtIndex_3 = List.GetItemAtIndex(list=transpose, index=code_block_3)
string_from_object_3 = FromObject(getItemAtIndex_3)
setParameterByName_3 = Element.SetParameterByName(element=all_elements_of_category, parameterName=string_4, value=string_from_object_3)
string_5 = StringInput("Bauabschnitt")
code_block_4 = CodeBlock { 14; }
# note: Family and Type built in parameter
# note: Bauabschnitt
getItemAtIndex_4 = List.GetItemAtIndex(list=transpose, index=code_block_4)
string_from_object_4 = FromObject(getItemAtIndex_4)
setParameterByName_4 = Element.SetParameterByName(element=all_elements_of_category, parameterName=string_5, value=string_from_object_4)
string_6 = StringInput("Geschoss")
code_block_5 = CodeBlock { 15; }
# note: Geschoss
getItemAtIndex_5 = List.GetItemAtIndex(list=transpose, index=code_block_5)
string_from_object_5 = FromObject(getItemAtIndex_5)
setParameterByName_5 = Element.SetParameterByName(element=all_elements_of_category, parameterName=string_6, value=string_from_object_5)
